# Grasshopper definition Artigo01_v_2.0.gh (Grasshopper 0.9.76)
# plug-ins: Python Interpreter

curve = Curve(<curve referenced from the Rhino model>)
vector_xyz = VectorXYZ(XComponent=Slider(0.6, range=0..3), YComponent=Slider(0.86, range=0..3), ZComponent=Slider(1.48, range=0..3))  # -> Vector, Length
vector_xyz_2 = VectorXYZ(XComponent=Slider(0.17, range=0..3), YComponent=Slider(0, range=0..3), ZComponent=Slider(0.11, range=0..3))  # -> Vector, Length
vector_xyz_3 = VectorXYZ(XComponent=Slider(0.16, range=0..3), YComponent=Slider(3, range=0..3), ZComponent=Slider(3, range=0..3))  # -> Vector, Length
vector_xyz_4 = VectorXYZ(XComponent=Slider(0.6, range=0..3), YComponent=Slider(0.86, range=0..3), ZComponent=Slider(1.48, range=0..3))  # -> Vector, Length
vector_xyz_5 = VectorXYZ(XComponent=Slider(2.48, range=0..3), YComponent=Slider(1.56, range=0..3), ZComponent=Slider(0.39, range=0..3))  # -> Vector, Length
vector_xyz_6 = VectorXYZ(XComponent=Slider(1.19, range=0..3), YComponent=Slider(1.1, range=0..3), ZComponent=Slider(2.2, range=0..3))  # -> Vector, Length
curve_2 = Curve(<curve referenced from the Rhino model>)
gouraud = PythonScript(Triang=curve, u=Slider(0.71, range=0..1), v=Slider(0.2, range=0..1))  # -> out, face, Mp, b, bc; inputs Triang: Curve
# ---------- gouraud: Python ----------
import rhinoscriptsyntax as rs
from Rhino.Geometry import Point3d, Vector3d, Vector3f, Matrix, Surface, Curve, Transform

    
def vecXmat(X, Y):
    result = [0,0,0]
    for j in range(3):
            # iterate through rows of Y
            for k in range(3):
                result[j] += X[k] * Y[j,k]
    return result



w = 1- u - v
vUVW = [u,v,w]



Pn = rs.PolylineVertices(Triang)[:-1]

bcX = (Pn[0].X + Pn[1].X + Pn[2].X)/3
bcY = (Pn[0].Y + Pn[1].Y + Pn[2].Y)/3
bcZ = (Pn[0].Z + Pn[1].Z + Pn[2].Z)/3

bc = Point3d(bcX, bcY, bcZ)

face = rs.AddSrfPt(Pn)

Mp = Matrix(3,3)

for i in range(3):
    
    for j in range(3):
        Mp[i,j] = Pn[j][i]


b = vecXmat(vUVW, Mp)
b = Point3d(b[0], b[1], b[2])




inter = rs.CurveCurveIntersection( rs.AddLine(bc, b), Triang)
#if  inter is not None:
#    b = inter[0][1]
# ---------- end gouraud ----------
curve_3 = Curve(<curve referenced from the Rhino model>)
phong_teselation = PythonScript(
    Triang=curve_2,
    u=Slider(1, range=0..1),
    v=Slider(0, range=0..1),
    alpha=Slider(0, range=0..1),
    v1=vector_xyz_3.Vector,
    v2=vector_xyz_2.Vector,
    v3=vector_xyz.Vector)  # -> out, Pn, Vn, face, Mp, Mpp, b, c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; inputs Triang: Curve, v1: Vector3d, v2: Vector3d, v3: Vector3d
# ---------- phong_teselation: Python ----------
import rhinoscriptsyntax as rs
from Rhino.Geometry import Point3d, Vector3d, Vector3f, Matrix, Surface, Curve, Transform, Plane, Line
from Rhino.Geometry.Intersect.Intersection import LinePlane

    
def vecXmat(X, Y):
    result = [0,0,0]
    for j in range(3):
            # iterate through rows of Y
            for k in range(3):
                result[j] += X[k] * Y[j,k]
    return result
    
def Baricnetro(Pn):
    bcX = (Pn[0].X + Pn[1].X + Pn[2].X)/3
    bcY = (Pn[0].Y + Pn[1].Y + Pn[2].Y)/3
    bcZ = (Pn[0].Z + Pn[1].Z + Pn[2].Z)/3
    # baricentro
    bc = Point3d(bcX, bcY, bcZ)
    return bc
# coordenada w
w = 1- u - v 
# vetor uvw
vUVW = [u,v,w]




# vertices da face
Pn = rs.PolylineVertices(Triang)[:-1]

# coordenadas baricentricas

bc = Baricnetro(Pn)

# Normal do plano
## Criando o plano
pl = Plane(rs.PlaneFromPoints(Pn[0], Pn[1], Pn[2]))
## Normal do plano
plN = pl.ZAxis

# vetor das normais
Vn = [v1 + plN, v2 + plN, v3 + plN]


plList = []
for i in range(3):
    bcV = rs.VectorCreate( Pn[i], bc)
    vAux = rs.VectorCrossProduct( bcV, plN)
 
    plAux = Plane(rs.PlaneFromFrame(Pn[i], vAux, Vn[i]) )
    plList.append(plAux)




face = rs.AddSrfPt(Pn)

Mp = Matrix(3,3)

for i in range(3):
    
    for j in range(3):
        Mp[i,j] = Pn[j][i]

# interpolando
b = vecXmat(vUVW, Mp)
b = Point3d(b[0], b[1], b[2])

# projeções nos planos
pjList =[]

for i in range(3):
    plAux = plList[i]
    
    ln = Line(b, plAux.ZAxis, 1)
  
    boolcontrol , lnParam = LinePlane(ln, plAux);
    ptPr = ln.PointAt(lnParam)

    pjList.append(ptPr)

Mpp = Matrix(3,3)

for i in range(3):
    
    for j in range(3):
        Mpp[i,j] = pjList[j][i]

c = vecXmat(vUVW, Mpp)
print c

c = Point3d(c[0], c[1], c[2])

pFinal = (1 - alpha) * b + (alpha * c)

for i in range(len(Vn)):
    Vn[i] = rs.VectorUnitize(Vn[i])
# ---------- end phong_teselation ----------
phong = PythonScript(
    Triang=curve_3,
    u=Slider(0.24, range=0..1),
    v=Slider(0.34, range=0..1),
    v1=vector_xyz_6.Vector,
    v2=vector_xyz_5.Vector,
    v3=vector_xyz_4.Vector)  # -> out, Pn, Vn, face, Mp, b, c, bc; inputs Triang: Curve, v1: Vector3d, v2: Vector3d, v3: Vector3d
# ---------- phong: Python ----------
import rhinoscriptsyntax as rs
from Rhino.Geometry import Point3d, Vector3d, Vector3f, Matrix, Surface, Curve, Transform, Plane

    
def vecXmat(X, Y):
    result = [0,0,0]
    for j in range(3):
            # iterate through rows of Y
            for k in range(3):
                result[j] += X[k] * Y[j,k]
    return result

# coordenada w
w = 1- u - v 
# vetor uvw
vUVW = [u,v,w]




# vertices da face
Pn = rs.PolylineVertices(Triang)[:-1]

# coordenadas baricentricas
bcX = (Pn[0].X + Pn[1].X + Pn[2].X)/3
bcY = (Pn[0].Y + Pn[1].Y + Pn[2].Y)/3
bcZ = (Pn[0].Z + Pn[1].Z + Pn[2].Z)/3
# baricentro
bc = Point3d(bcX, bcY, bcZ)

# Normal do plano
## Cirndo o plano
pl = Plane(rs.PlaneFromPoints(Pn[0], Pn[1], Pn[2]))
## Normal do plano
plN = pl.ZAxis


# vetor das normais
Vn = [v1 + plN, v2 + plN, v3 + plN]

face = rs.AddSrfPt(Pn)
#fn = rs.surfe
Mp = Matrix(3,3)

for i in range(3):
    
    for j in range(3):
        Mp[i,j] = Pn[j][i]



Mv = Matrix(3,3)

for i in range(3):
    
    for j in range(3):
        Mv[i,j] = Vn[j][i]


b = vecXmat(vUVW, Mp)
c = vecXmat(vUVW, Mv)

b = Point3d(b[0], b[1], b[2])

c = rs.VectorUnitize(Vector3d(c[0], c[1], c[2]))


for i in range(len(Vn)):
    Vn[i] = rs.VectorUnitize(Vn[i])
    
inter = rs.CurveCurveIntersection( rs.AddLine(bc, b), Triang)   
#if  inter is not None:
#    b = inter[0][1]
# ---------- end phong ----------
display_matrix = DisplayMatrix(gouraud.Mp)
panel = Panel(gouraud.b)
data = Data(gouraud.b)
data_2 = Data(gouraud.bc)
panel_2 = Panel(gouraud.bc)
phong_tesselation = Data(phong_teselation.c)
planos_tangentes = Data(phong_teselation.plList)
q = Data(phong_teselation.pjList)
baricentro = Data(phong_teselation.bc)
face = Data(phong_teselation.face)
linear = Data(phong_teselation.b)
phong_tessellation_alpha = Data(phong_teselation.pFinal)
display_matrix_2 = DisplayMatrix(phong.Mp)
panel_3 = Panel(phong.b)
vector_display = VectorDisplay(Anchor=phong_teselation.Pn, Vector=phong_teselation.Vn)
vector_display_2 = VectorDisplay(Anchor=phong.Pn, Vector=phong.Vn)
panel_4 = Panel(phong_teselation.pjList)
panel_5 = Panel(phong_teselation.b)
vector_display_3 = VectorDisplay(Anchor=phong.b, Vector=phong.c)
display_matrix_3 = DisplayMatrix(phong_teselation.Mp)
display_matrix_4 = DisplayMatrix(phong_teselation.Mpp)
polyline = PolyLine(Vertices=q, Closed=True)
line = Line(StartPoint=phong_teselation.b, EndPoint=q)
